# Grasshopper definition outdoorconditions_example.gh (Grasshopper 0.9.76)
# plug-ins: Python Interpreter

# This is an example script for the use of Rooster
# Rooster is a tool to approximate indoor temperatures and velocities.
# ______________
# 
# 06/12/2019
# Anna Krusell
# Kristine Marburger
# Use component from livestock3d to use Rooster. Insert the path to python.exe. It can be found in the Anaconda folder.
python_executor = PythonScript(PythonPath="C:\Users\s1638\Anaconda3\python.exe")  # -> readMe
# ---------- python_executor: Python ----------
"""
This component sets the path to the CPython executor.
    
    Args:
        PythonPath: Path to python.exe.
    Returns:
        readMe!: In case of any errors, it will be shown here..
"""

#------------------------------------------------------------------------------#
# Imports
import os
import scriptcontext as sc
import Grasshopper.Kernel as gh

#------------------------------------------------------------------------------#
# Functions

def check_inputs(py_exe):
    """
    Checks inputs and raises a warning if an input is not the correct type.
    """
    
    if py_exe:
        if os.path.exists(py_exe):
            return True
        else:
            warning = 'Component can not find Python'
            print(warning)
            w = gh.GH_RuntimeMessageLevel.Warning
            ghenv.Component.AddRuntimeMessage(w, warning)

def main(py_exe):
    """
    In case all the checks have passed the component runs.
    It prints the python.exe path and creates a scriptcontext.sticky with the path.
    """

    if check_inputs(py_exe):
        print('Python Executor is set to: ' + py_exe)
        sc.sticky['PythonExe'] = py_exe

#------------------------------------------------------------------------------#
# Execution

main(PythonPath)
# ---------- end python_executor ----------
window_orientation = Panel("N")
outdoor_velocity = Panel("6")
# Calculate the velocity of the air through the window, based on the orientation (N,S,E or W) and the outdoor velocity.
convert_velocity = ConvertVelocity(vOutdoor=outdoor_velocity, windowOrientation=window_orientation)  # -> vWindow
# ---------- convert_velocity: Python ----------
"""
Use this component to calculate the velocity through the window, given an outdoor velocity and an orientation of the window opening ('N','S','E','W').

    Args:
        vOutdoor: The outdoor velocity [m/s]
        windowOrientation: Choose between 'N','S','E','W'.  
    Returns:
        vWindow: The velocity through the window opening. 
"""

import math

def Deg(windowOrientation):
    if windowOrientation == 'W':
        Ori = 0
    elif windowOrientation == 'N':
        Ori = 90
    elif windowOrientation =='E':
        Ori = 180
    elif windowOrientation == 'S':
        Ori = 270
    return Ori
    
O = Deg(windowOrientation)


def Correlation(O, vOutdoor):
    if (vOutdoor >= 2 and vOutdoor <= 12):
        y = 7.74323020*10**(-12) *O**4 -5.57505716*10**(-9)*O**3 + 1.83476749*10**(-6)*O**2 -2.99257037*10**(-4)*O +2.38550000*10**(-2)
        y1= y* (vOutdoor)
    else:
        print('Choose a velocity between 2 and 12 m/s')
    
    return y1

vWindow = Correlation(O, vOutdoor)
# ---------- end convert_velocity ----------
# Let Ladybug fly to calculate PMV values.
ladybug = Ladybug_Ladybug()  # -> Vviiiiiiiiiizzz; plug-in component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
wind_direction = Panel("W")
# Find the corresponding outdoor velocity if the window orientation is not windward. Do this based on the found velocity through the window and the wind direction (the direction the wind is coming from).     Use the corresponding outdoor velocity in the "temperature model" and "velocity model".
modifiedwindspeed = ModifiedWindspeed(vWindow=convert_velocity, windDirection=wind_direction)  # -> outdoorVelocity
# ---------- modifiedwindspeed: Python ----------
"""
Use this component to calculate the velocity outdoor velocity corresponding to the velocity through the window, given a velocity through the window and orientation of the window opening ('N','S','E','W').

    Args:
        vWindow: The velocity through the window [m/s].
        windDirection: Choose between 'N','S','E','W'. 
    Returns:
        outdoorVelocity: The outdoor velocity corresponding to the windDirection [m/s]. 
"""


import math

def Orifunc(vWindow,windDirection):
    if windDirection == 'W':
        
        Y2 = 41.26219585 * vWindow + 0.093960602
        
    elif windDirection == 'E':
        
        Y2 = 141.8079448 * vWindow + 1.820639827
        
    elif windDirection == 'S':
        
        Y2 = 90.32795328 * vWindow + 1.808697953
        
    elif windDirection == 'N':
        
        Y2 = 89.99261937 * vWindow + 1.898499148
        
    return Y2

outdoorVelocity = Orifunc(vWindow, windDirection)
# ---------- end modifiedwindspeed ----------
# Choose timestep for analysis
time = Panel("""10
20
30
40
50
60
70
80
90
100
110
120
130
140
150
160
170
180
190
200""")
item = ListItem(List=time, Index=Slider(19, range=10..200), Wrap=True)
# Choose distance for analysis starts at 0.2m ends at chosen distance. (for easy visualisation choose room depth)
distance = Panel("7")
# Choose height for analysis. You can choose between height 1 (0.1m),  height 2 (1.1m) or  height 3 (1.75m)
height = Panel("3")
# Window floor ratio calculated as the precentage opening area [m^2] of the floor area [m^2]
window_floor_ratio_wfr = Panel("0.0612")
room_depth = Panel(distance)
room_witdh = Panel("3.5")
outdoor_velocity_2 = Panel(outdoor_velocity)
outdoor_temperature = Panel("10")

# ---- group: Push me!
toggle = BooleanToggle(True)

# ----
# Input everything into the temperature and velocity models for approximation.
temperature_model = TemperatureModel(
    time=item,
    distance=distance,
    height=height,
    depth=room_depth,
    width=room_witdh,
    WFR=window_floor_ratio_wfr,
    outdoor_velocity=modifiedwindspeed,
    outdoor_temperature=outdoor_temperature,
    run=toggle)  # -> indoor_temperature
# ---------- temperature_model: Python ----------
"""
Use this component to approximate the indoor temperatures for each 0.1 m interval and at a specific height(1,2,3) to a chosen time given the outdoor velocity [m/s], outdoor temperature [degrees Celsius], the window floor ratio [a number between 0-1] and the height, distance [m], time [s] and dimensions of the room [m]. 

    Args:
        time: Choose a time between 10 and 200 [s] (ex. 10,20,30..).
        distance: Choose the distance inside the room for analysis given in meters.
        height: The given height (Chose between 1,2 and 3. The corresponding heights are 0.1, 1.1 and 1.75 meters above the floor).
        depth: The depth of the room, given in meters.
        width: The width of the room (opening-side), given in meters.
        WFR: The window floor ratio (in the calculation of this, use the opening area)
        outdoor_velocity: The outdoor velocity [m/s].
        outdoor_temperature: The outdoor temperature [degrees Celsius]. 
    Returns:
        indoor_temperature: The temperature inside the room at the specified height and distance [degrees Celsius]. Prints a temperature for each 0.1 m from the window. 
"""

#------------------------------------------------------------------------------#
# Imports
import os
import scriptcontext as sc
import subprocess
import livestock3d

#------------------------------------------------------------------------------#
# Functions

def write_file(file_path, time, distance, height, depth, width, WFR, outdoor_velocity, outdoor_temperature):
    file = open(file_path, 'w')
    file.write(str(int(time)) + '\n')
    file.write(str(distance) + '\n')
    file.write(str(height) + '\n')
    file.write(str(depth) + '\n')
    file.write(str(width) + '\n')
    file.write(str(WFR) + '\n')
    file.write(str(outdoor_velocity) + '\n')
    file.write(str(outdoor_temperature) + '\n')
    file.close()

def write_template(template, path):
    livestock3d.pick_template(template, path)

def run_template(py_exe, template_to_run):
    thread = subprocess.Popen([py_exe, template_to_run])
    thread.wait()
    thread.kill()
    
def load_file(file):
    file = open(file, 'r')
    lines = file.readlines()
    file.close()
    
    return lines

def print_lines(lines):
    for line in lines:
        print(line.strip())
        
        
#------------------------------------------------------------------------------#
# Execution

# Get CPython path from the other component
py = str(sc.sticky["PythonExe"])

# Make folder
folder = r'C:\livestock3d\data'
if not os.path.exists(folder):
    os.mkdir(folder)

# Specify paths 
txt_file = folder + '/data_file.txt'
template_file = folder + '/Rooster_boost_model_gen_template.py'
result_file = folder + '/result2.txt'

# Run functions
if run:
    write_file(txt_file, time, distance, height, depth, width, WFR, outdoor_velocity, outdoor_temperature)
    write_template('Rooster_boost_model_gen_template', folder)
    run_template(py, template_file)
    data = load_file(result_file)
    print_lines(data)
# ---------- end temperature_model ----------
velocity_model = VelocityModel(
    time=item,
    distance=distance,
    height=height,
    depth=room_depth,
    width=room_witdh,
    WFR=window_floor_ratio_wfr,
    outdoor_velocity=modifiedwindspeed,
    outdoor_temperature=outdoor_temperature,
    run=toggle)  # -> indoor_velocity
# ---------- velocity_model: Python ----------
"""
Use this component to approximate the indoor tvelocity for each 0.1 m interval and at a specific height(1,2,3) to a chosen time given the outdoor velocity [m/s], outdoor temperature [degrees Celsius], the window floor ratio [a number between 0-1] and the height, distance [m], time [s] and dimensions of the room [m]. 

    Args:
        time: Choose a time between 10 and 200 [s] (ex. 10,20,30..).
        distance: Choose the distance inside the room for analysis given in meters.
        height: The given height (Chose between 1,2 and 3. The corresponding heights are 0.1, 1.1 and 1.75 meters above the floor).
        depth: The depth of the room, given in meters.
        width: The width of the room (opening-side), given in meters.
        WFR: The window floor ratio (in the calculation of this, use the opening area)
        outdoor_velocity: The outdoor velocity [m/s].
        outdoor_temperature: The outdoor temperature [degrees Celsius]. 
    Returns:
        indoor_velocity: The velocity inside the room at the specified height and distance [m/s]. Prints a velocity for each 0.1 m from the window.
"""

#------------------------------------------------------------------------------#
# Imports
import os
import scriptcontext as sc
import subprocess
import livestock3d

#------------------------------------------------------------------------------#
# Functions

def write_file(file_path, time, distance, height, depth, width, WFR, outdoor_velocity, outdoor_temperature):
    file = open(file_path, 'w')
    file.write(str(int(time)) + '\n')
    file.write(str(distance) + '\n')
    file.write(str(height) + '\n')
    file.write(str(depth) + '\n')
    file.write(str(width) + '\n')
    file.write(str(WFR) + '\n')
    file.write(str(outdoor_velocity) + '\n')
    file.write(str(outdoor_temperature) + '\n')
    file.close()

def write_template(template, path):
    livestock3d.pick_template(template, path)

def run_template(py_exe, template_to_run):
    thread = subprocess.Popen([py_exe, template_to_run])
    thread.wait()
    thread.kill()
    
def load_file(file):
    file = open(file, 'r')
    lines = file.readlines()
    file.close()
    
    return lines

def print_lines(lines):
    for line in lines:
        print(line.strip())
        
        
#------------------------------------------------------------------------------#
# Execution

# Get CPython path from the other component
py = str(sc.sticky["PythonExe"])

# Make folder
folder = r'C:\livestock3d\data'
if not os.path.exists(folder):
    os.mkdir(folder)

# Specify paths 
txt_file = folder + '/data_file.txt'
template_file = folder + '/Rooster_v_boost_template.py'
result_file = folder + '/result2.txt'

# Run functions
if run:
    write_file(txt_file, time, distance, height, depth, width, WFR, outdoor_velocity, outdoor_temperature)
    write_template('Rooster_v_boost_template', folder)
    run_template(py, template_file)
    data = load_file(result_file)
    print_lines(data)
# ---------- end velocity_model ----------
temperatures_for_each_distance = Panel(temperature_model)
velocities_for_each_distance = Panel(velocity_model)
# Use Ladybug PMV calculator input known parameters.
pmvcomfortcalculator = Ladybug_PMVComfortCalculator(
    dryBulbTemperature=temperatures_for_each_distance,
    windSpeed=velocities_for_each_distance,
    relativeHumidity="50",
    metabolicRate="1",
    clothingLevel="0.7",
    calcBalanceTemperature=False,
    runIt=Toggle(True))  # -> readMe, port, predictedMeanVote, percentPeopleDissatisfied, standardEffectiveTemperature, port_2, comfortableOrNot, percentOfTimeComfortable, port_3, balanceTemperature; plug-in component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
low_bound = Panel("-3")
high_bound = Panel("3")
# Visualize room geometry and PMV values for each distance.
pmv_visualisation = PMV_Visualisation(
    lowbound=low_bound,
    highbound=high_bound,
    A_2=room_witdh,
    A=room_depth,
    index=height,
    pmv=pmvcomfortcalculator.predictedMeanVote)  # -> newmesh, newlegend, geometry
mesh = Mesh([pmv_visualisation.newmesh, pmv_visualisation.newlegend])
brep = Brep(pmv_visualisation.geometry)

# ==== cluster PMV_Visualisation: Visualisation of the PMV values for a chosen height
A = ClusterInput()
A_2 = ClusterInput()
height = Panel("1.4")
depth = Division(A=A, B="2")
index = ClusterInput()
width = Division(A=A_2, B="2")
panel = Panel("""0
0.1
1.1
1.75""")
panel_2 = Panel("0.1")
center_box = CenterBox(Base=PlaneXY(0, 0, 0), X=width, Y=depth, Z=height)
list_item = ListItem(List=panel, Index=index, Wrap=True)
brep = Brep(center_box)
geometry = ClusterOutput(brep)
deconstruct_brep = DeconstructBrep(Brep=brep)  # -> Faces, Edges, Vertices
list_item_2 = ListItem(List=deconstruct_brep.Faces, Index=0, Wrap=True)
face_normals = FaceNormals(Mesh=list_item_2)  # -> Centers, Normals
vector_xyz = VectorXYZ(XComponent=0, YComponent=0, ZComponent="-0.175")  # -> Vector, Length
list_item_3 = ListItem(List=deconstruct_brep.Faces, Index="4", Wrap=True)
vector_xyz_2 = VectorXYZ(XComponent=0, YComponent=0, ZComponent=list_item)  # -> Vector, Length
point = Point(face_normals.Centers)
move = Move(Geometry=point, Motion=vector_xyz.Vector)  # -> Geometry, Transform
settings_custom = SettingsCustom(
    StitchSeams=True,
    SimplePlanes=False,
    Refine=True,
    MinCount=16,
    MaxCount=400,
    AspectRatio=20,
    MaxDistance=0,
    MaxAngle=20,
    MinEdge="0.3",
    MaxEdge="0.3")
offset = Offset(Curve=list_item_3, Distance="-0.2", Plane=PlaneXY(0, 0, 0), Corners=1)
pmv = ClusterInput()
mesh_brep = MeshBrep(Brep=offset, Settings=settings_custom)
move_2 = Move(Geometry=mesh_brep, Motion=vector_xyz_2.Vector)  # -> Geometry, Transform
pmv_2 = Data(pmv)
deconstruct_mesh = DeconstructMesh(Mesh=move_2.Geometry)  # -> Vertices, Faces, Colours, Normals
pmv_3 = Panel(pmv_2)
highbound = ClusterInput()
lowbound = ClusterInput()
point_2 = Point(deconstruct_mesh.Vertices)
distance = Distance(PointA=point_2, PointB=move.Geometry)
legendpar = Ladybug_LegendParameters(lowBound=lowbound, highBound=highbound)  # -> legendPar; plug-in component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
round = PythonScript(x=distance)  # -> flatten(a)
# ---------- round: Python ----------
import math

def roundnum(x):
    y = round(x, 1)
    return y 


a = roundnum(x)
# ---------- end round ----------
addition = Addition(A=pmv_3, B="1")
list_length = ListLength(List=addition)

# ---- group: Python
point_distances = Panel(round)
pmv_values_for_distances = Panel(pmv_3)
bounds = Bounds(Numbers=point_distances)

# ----
clean = PythonScript(x=point_distances)  # -> out, a; inputs x: list
# ---------- clean: Python ----------
def cleanx(x):
    for a in range (len(x)):
       if x[a] == max(x):
         x[a] = (float(max(x))-0.1)
    return x

a = cleanx(x)
# ---------- end clean ----------
panel_3 = Panel(bounds)
range = Range(Domain=bounds, Steps=list_length)
text_split = TextSplit(Text=panel_3, Separators="To")
round_2 = PythonScript(x=range)  # -> flatten(a); same code as round
panel_4 = Panel(text_split)
panel_5 = Panel(round_2)
cull_index = CullIndex(List=panel_4, Indices="1", Wrap=True)
panel_6 = Panel(cull_index)
list_length_2 = ListLength(List=round_2)
python_script = PythonScript(bound=panel_6, length=list_length_2)  # -> out, flatten(dist); inputs bound: list
# ---------- python_script: Python ----------
def distances(length, bound):
    
    newdist = []
    
    for x in range(int(float(bound[1])*10-float(bound[0]))):
        newdist.append(float(bound[0])+(x*0.1))
    return newdist


dist = distances(length,bound)
# ---------- end python_script ----------
panel_7 = Panel(python_script.dist)

# ---- group: Python (continued)
distances_for_pmv = Panel(panel_5)
python_script_2 = PythonScript(x=clean.a, PMV=flatten(pmv_values_for_distances), distances=panel_7)  # -> out, PMV_out; inputs x: list, PMV: list, distances: list
# ---------- python_script_2: Python ----------
def PMV_calc(x, PMV, distances):
    for z in range ((len(distances))-1):
        for y in range ((len(x))):
            if x[y] == distances[z]:
                x[y] = PMV[z]
    return x

PMV_out = PMV_calc(x,PMV,distances)
# ---------- end python_script_2 ----------
panel_8 = Panel(python_script_2.PMV_out)

# ----
clean_2 = PythonScript(x=flatten(panel_8), PMV=flatten(pmv_values_for_distances))  # -> out, a; inputs x: list, PMV: list
# ---------- clean_2: Python ----------
def cleanx(x,PMV):
    res = []
    for a in range(0, (len(x)-1)) : 
        if abs(float(x[a])) > 3: 
            res.append(a) 
    return res

a = cleanx(x,PMV)
# ---------- end clean_2 ----------
clean_3 = PythonScript(x=flatten(panel_8), PMV=flatten(pmv_values_for_distances))  # -> out, a; inputs x: list, PMV: list
# ---------- clean_3: Python ----------
def cleanx(x):
    
    for a in range (len(x)):
        if x[a] == max(x):
            x[a] = PMV[len(PMV)-1]
    for a in range (len(x)):
        if x[a] == max(x):
            x[a] = PMV[len(PMV)-1]
    return x

a = cleanx(x)
# ---------- end clean_3 ----------
list_length_3 = ListLength(List=distances_for_pmv)
panel_9 = Panel(clean_2.a)
subtraction = Subtraction(A=list_length_3, B="2")
python_script_3 = PythonScript(index=panel_9, PMV=clean_3.a, PMV2=pmv_values_for_distances, x=subtraction)  # -> out, a; inputs index: list, PMV: list, PMV2: list
# ---------- python_script_3: Python ----------
def fix(index, PMV, PMV2,x):
    for y in range (len(index)):
        PMV[int(index[y])] = PMV2[x]
    return PMV


a = fix(index, PMV, PMV2,x)
# ---------- end python_script_3 ----------
panel_10 = Panel(python_script_3.a)
recolormesh = Ladybug_RecolorMesh(
    analysisResult=panel_10,
    inputMesh=move_2.Geometry,
    legendPar=legendpar,
    analysisTitle="PMV_results",
    legendTitle="PMV [-3,3]")  # -> out, newMesh, newLegend, legendBasePt, meshColors, legendColors; plug-in component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
newmesh = ClusterOutput(recolormesh.newMesh)
newlegend = ClusterOutput(recolormesh.newLegend)
data = Data(panel_7)
